% Simulink data dictionary Contactors_data.sldd

ContactorsInputs_BUS = Simulink.Bus()
  VESIVT: double, Unit="V"  % ES IVT Voltage Measurement
  VCUKIVT: double, Unit="V"  % CUK IVT Voltage Measurement
  NPTState: double  % Main Powertrain State

tSimCont = Simulink.Parameter(0.005, DataType="double")
tCloseContDelay = Simulink.Parameter(0.2)

ContactorsCmds_BUS = Simulink.Bus()
  BContPosRequested: boolean
  BContNegRequested: boolean
  BPrechargeRequested: boolean
  BActiveDischargeRequested: boolean