% Simulink data dictionary MotorControl_data.sldd

J = Simulink.Parameter(0.0036, DataType="single", Unit="kgm^2")  % Physical Inertia
Rs = Simulink.Parameter(0.00423, DataType="single", Unit="Ω")  % Stator Resistance Per Phase
F = Simulink.Parameter(0.0011, DataType="single", Unit="Nm/rad/s")  % Viscous Damping
tSimMoCo = Simulink.Parameter(1.0e-5, Unit="s")  % Simulation Step Time
Tf = Simulink.Parameter(0, DataType="single", Unit="Nm")  % Static Friction
NPoles = Simulink.Parameter(6, DataType="single")  % Number of Poles
Ke = Simulink.Parameter(59.16664, DataType="single", Unit="Vpk_LL/krpm")  % Back-emf Constant
Ld = Simulink.Parameter(0.000171, DataType="single", Unit="H")  % Stator d-axis Inductance
Lq = Simulink.Parameter(0.000391, DataType="single", Unit="H")  % Stator q-axis Inductance
w_eff_bp = Simulink.Parameter([-1000 -500 0 500 1000])  % Vector of Speeds for Tabulated Losses
T_eff_bp = Simulink.Parameter([-200 -100 0 100 200])  % Vector of Torques for Tabulated Losses

ploss_table = Simulink.Parameter([1 0.999 0.989 0.997 0.996
 0.995 0.994 0.993 0.992 0.991
 0.99 0.989 0.988 0.987 0.986
 0.985 0.984 0.983 0.982 0.981
 0.98 0.979 0.978 0.977 0.976])  % Power Loss Table